# Grasshopper definition 20180915_Def Template.gh (Grasshopper 1.0.7)

# ---- group: User Input
# Duplicating the parameters makes
# it easy to copy paste them.
number_slider = Slider(87, range=0..1000)
value_2 = Number(Slider(119, range=0..1000))
value_3 = Number(Slider(46, range=0..1000))
value_1 = Number(number_slider)
value_2_2 = Number(value_2)
value_3_2 = Number(value_3)
value_1_2 = Number(value_1)

# ---- group: Another Regular Group
# Group Outpus
# Group Inputs
value_1_3 = Number(value_1_2)
value_2_3 = Number(value_2_2)
value_3_3 = Number(value_3_2)
pt = ConstructPoint(XCoordinate=value_1_3, YCoordinate=value_2_3, ZCoordinate=value_3_3)
pt_2 = Point(pt)

# ---- group: Regular Group
value_1_4 = Number(value_1_2)
value_2_4 = Number(value_2_2)
value_3_4 = Number(value_3_2)
addition = Addition(A=value_1_4, B=value_2_4)
addition_2 = Addition(A=addition, B=value_3_4)
result = Number(addition_2)

# ----
pt_3 = Point(pt_2)
radius = Number(result)
circle = CircleCNR(Center=pt_3, Normal=Vector(0, 0, 1), Radius=radius)
circle_2 = Circle(circle)

# ---- group: End Geometry
# The final geometry stays a the end of the definiton. Selecting all the components in the group and baking them will produce all the geometry necessary to fabricate the project.
circle_3 = Circle(circle_2)

# ---- group: Preview Group
geo = Geometry(circle_3)
preview = CustomPreview(Geometry=geo, Material=ColourSwatch(SwatchColor=RGB(255, 0, 212)))
